# Grasshopper definition 001.gh (Grasshopper 0.9.76)

c_script = CSharpScript()  # -> out, A, B
# ---------- c_script: C# ----------
    var moji = new List<Curve>();
    var sen = new List<Line>();
    sen.Add(new Line(30, 0, 0, 45, 0, 0));
    for(int i = 150;i <= 182;i++){
      double xco = 100 / Math.Pow(i / 100.0, 2);
      double hmemori = i % 10 == 0 ? -2.0 : (i % 5 == 0 ? -1.5 : -1.0);
      sen.Add(new Line(xco, 0, 0, xco, hmemori, 0));
      if(i % 10 == 0)moji.AddRange(GetText(RhinoDocument, (i / 100.0).ToString(), xco, hmemori - 0.2));
    }
    for(int i = 300;i <= 450;i += 5){
      double xco = i / 10.0;
      double hmemori = i % 100 == 0 ? 2.0 : (i % 50 == 0 ? 5.0 / 3 : (i % 10 == 0 ? 4.0 / 3 : 1));
      sen.Add(new Line(xco, 0, 0, xco, hmemori, 0));
      if(i % 100 == 0)moji.AddRange(GetText(RhinoDocument, (i / 1000.0).ToString(), xco, hmemori + 0.2));
    }
    A = sen;
    B = moji;
# ---------- c_script: C# additional code ----------
  Curve[] GetText(RhinoDoc rd, string text, double x, double y){
    TextEntity TE = new TextEntity();
    TE.Plane = new Plane(new Point3d(0, 0, 0), new Vector3d(1, 0, 0), new Vector3d(0, 1, 0));
    TE.Justification = TextJustification.MiddleCenter;
    TE.Text = text;
    TE.FontIndex = RhinoDocument.Fonts.FindOrCreate("Arial", false, false);
    TE.TextHeight = 0.5;
    TE.Translate(x, y, 0);
    return TE.Explode();
  }
# ---------- end c_script ----------
