# Grasshopper definition cf.gh (Grasshopper 0.9.76)

c_script = CSharpScript()  # -> out, A
# ---------- c_script: C# ----------
    var list = new List<Line>();
    for(var i = 10;i <= 60;i++){
      list.Add(new Line(i, 0, 0, i, f(i), 0));
    }
    for(var i = 50;i <= 140;i++){
      var c = (i - 32.0) * 5.0 / 9.0;
      list.Add(new Line(c, 0, 0, c, -f(i), 0));
    }
    A = list;
# ---------- c_script: C# additional code ----------
  double f(int i){return i % 10 == 0 ? 3 : (i % 5 == 0 ? 2.5 : 2);}
# ---------- end c_script ----------
