# Grasshopper definition KJ.02.gh (Grasshopper 0.9.76)

c_script = CSharpScript(x=Slider(83, range=0..100))  # -> out, A, B; inputs x: Double
# ---------- c_script: C# ----------
    var list = new List<Line>();
    var texts = new List<Curve>();
    int max = 10000;
    double minwid = 0.18;
    double minwidtext = 5;
    int start = 100;
    double scale = x / (yp(1, max) - yp(1, start));
    for(var i = start;i <= max;i++){
      var ypl = yp(scale, i);
      if(habatest(scale, i, minwid)){continue;}
      list.Add(new Line(ypl, 0, 0, ypl, CurrentTakasa(scale, i), 0));
      list.Add(new Line(ypl, 0, 0, ypl, -CurrentTakasa(scale, i), 0));

      int memori = i;
      while(memori % 10 == 0){memori /= 10;}
      if(habatest(scale, i, minwidtext * Math.Floor(Math.Log(memori, 10)))){continue;}
      texts.AddRange(GetText(RhinoDocument, memori.ToString(), ypl, -CurrentTakasa(scale, i) - 1.0));
      texts.AddRange(GetText(RhinoDocument, memori.ToString(), ypl, CurrentTakasa(scale, i) + 1.0));
    }
    A = list;
    B = texts;
# ---------- c_script: C# additional code ----------
  Curve[] GetText(RhinoDoc rd, string text, double x, double y){
    TextEntity TE = new TextEntity();
    TE.Plane = new Plane(new Point3d(0, 0, 0), new Vector3d(1, 0, 0), new Vector3d(0, 1, 0));
    TE.Justification = TextJustification.MiddleCenter;
    TE.Text = text;
    TE.FontIndex = RhinoDocument.Fonts.FindOrCreate("Arial", false, false);
    TE.TextHeight = 1.0;
    TE.Translate(x, y, 0);
    return TE.Explode();
  }


  int GetKizami(int i){
    int result = 0;
    while(true){
      if(i % 10 == 0){
        result += 2;
        i /= 10;
        continue;
      }else if(i % 5 == 0){
        return result + 1;
      }else{
        return result;
      }
    }
  }
  int GetKizamiSpace(int i,int offset=0){
    int a = GetKizami(i) + offset;
    int r = 1;
    for(int j = 0;j * 2 + 1 < a;j++){r *= 10;}
    if(a % 2 == 1){r *= 5;}
    return r;
  }
  double yp(double scale, double i){
    return scale * Math.Log(i);
  }
  double haba(double scale, double i, int count, double c2){
    return yp(scale, Math.Floor(i / c2) * c2 + count) - yp(scale, Math.Floor(i / c2) * c2);
  }
  double CurrentHaba(double scale, int i,int offset=0){
    int space = GetKizamiSpace(i);
    int space2 = GetKizamiSpace(i, offset);
    return yp(scale, Math.Floor((double) i / space2) * space2 + space) - yp(scale, Math.Floor((double) i / space2) * space2);
  }
  double CurrentTakasa(double scale, int i){
    return (Math.Log(CurrentHaba(scale, i) + 1)) / 1.2 + 0.8;
  }
  bool habatest(double scale, int i, double minwid){
    return CurrentHaba(scale, i, 1) < minwid;
  }
# ---------- end c_script ----------
crv = Curve(c_script.B)
line = Line(c_script.A)
