# Grasshopper definition bundoki.02.gh (Grasshopper 0.9.76)

c_script = CSharpScript()  # -> out, A
# ---------- c_script: C# ----------
    double s = 73;
    var curves = new List<Line>();
    curves.Add(new Line(0, 5, 0, 0, -5, 0));
    curves.Add(new Line(5, 0, 0, -5, 0, 0));
    for(int i = 0;f(i / 10.0, s + 1) < 53;i += 5){
      double t = s + g(i);
      double d = i / 10.0;
      curves.Add(new Line(f(d, s), s, 0, f(d, t), t, 0));
    }
    A = curves;
# ---------- c_script: C# additional code ----------
  double f(double a, double b){
    return Math.Tan(Math.PI / 180 * a) * b;
  }
  double g(int i){
    if(i % 100 == 0){
      return 2;
    }else if(i % 50 == 0){
      return 1.5;
    }else if(i % 10 == 0){
      return 1;
    }else if(i % 5 == 0){
      return 0.5;
    }
    return 0.25;
  }
# ---------- end c_script ----------
