# Grasshopper definition random_num_contains_all.gh (Grasshopper 0.9.76)

c_script = CSharpScript()  # -> out, A
# ---------- c_script: C# ----------
    var list = new List<int>();
    for(var i = 0;i < 2;i++){
      for(var j = 0;j < 10;j++){
        list.Add(j);
      }
    }
    var rand = new Random();
    for(var i = 0;i < 10000;i++){
      var a = rand.Next(list.Count());
      var b = rand.Next(list.Count());
      var c = list[a];
      list[a] = list[b];
      list[b] = c;
    }
    var s = "";
    foreach(var i in list){
      s += i.ToString();
    }
    Print(s);
# ---------- end c_script ----------
panel = Panel(c_script.out)
