# Grasshopper definition KJ.gh (Grasshopper 0.9.76)

c_script = CSharpScript(x=Slider(83, range=0..100), y=Slider(1.5, range=1..2))  # -> out, A, B; inputs x: Double, y: Double
# ---------- c_script: C# ----------
    var list = new List<Line>();
    var texts = new List<Curve>();
    int max = 3000;
    double minwid = 0.2;
    double minwidtext = 5;
    double scale = x / (yp(1, max, y) - yp(1, 10, y));
    for(var i = 10;i <= max;i++){
      var ypl = -yp(scale, i, y);
      if(habatest(scale, i, y, minwid)){continue;}
      list.Add(new Line(ypl, 0, 0, ypl, -f(i), 0));

      int memori = i;
      while(memori % 10 == 0){memori /= 10;}
      if(habatest(scale, i, y, minwidtext * Math.Floor(Math.Log(memori, 10)), 3)){continue;}
      TextEntity TE = new TextEntity();
      TE.Plane = new Plane(new Point3d(0, 0, 0), new Vector3d(1, 0, 0), new Vector3d(0, 1, 0));
      TE.Justification = TextJustification.MiddleCenter;
      TE.Text = "" + memori;
      TE.FontIndex = RhinoDocument.Fonts.FindOrCreate("Arial", false, false);
      TE.TextHeight = 1.0;
      TE.Translate(ypl, -f(i) - 1.0, 0);
      texts.AddRange(TE.Explode());
    }
    for(var i = 10;i <= max;i++){
      var ypl = -yp(scale, i, y);
      if(habatest(scale, i, y, minwid)){continue;}
      list.Add(new Line(ypl, 0, 0, ypl, f(i), 0));

      int memori = i;
      while(memori % 10 == 0){memori /= 10;}
      if(habatest(scale, i, y, minwidtext * Math.Floor(Math.Log(memori, 10)), 3)){continue;}
      TextEntity TE = new TextEntity();
      TE.Plane = new Plane(new Point3d(0, 0, 0), new Vector3d(1, 0, 0), new Vector3d(0, 1, 0));
      TE.Justification = TextJustification.MiddleCenter;
      TE.Text = "" + memori;
      TE.FontIndex = RhinoDocument.Fonts.FindOrCreate("Arial", false, false);
      TE.TextHeight = 1.0;
      TE.Translate(ypl, f(i) + 1.0, 0);
      texts.AddRange(TE.Explode());
    }
    A = list;
    B = texts;
# ---------- c_script: C# additional code ----------
  double f(int i){
    if(i % 100 == 0){
      return 3;
    }else if(i % 50 == 0){
      return 2.5;
    }else if(i % 10 == 0){
      return 2.0;
    }else if(i % 5 == 0){
      return 1.5;
    }
    return 1.0;
  }
  double yp(double scale, double i, double y){
    return scale * Math.Log(i, y);
  }
  double haba(double scale, double i, double y, int count, double c2){
    return yp(scale, Math.Floor(i / c2) * c2 + count, y) - yp(scale, Math.Floor(i / c2) * c2, y);
  }
  bool habatest(double scale, double i, double y, double minwid, int rep=2){
    int c = 1;
    for(int j = 0;j < rep;j++){
      if(haba(scale, i, y, 1 * c, c * 10) < minwid && i % (5 * c) != 0){return true;}
      if(haba(scale, i, y, 5 * c, c * 10) < minwid && i % (10 * c) != 0){return true;}
      c *= 10;
    }
    return false;
  }
# ---------- end c_script ----------
crv = Curve(c_script.B)
line = Line(c_script.A)
