# Grasshopper definition bundoki.gh (Grasshopper 0.9.76)

c_script = CSharpScript()  # -> out, A
# ---------- c_script: C# ----------
    double s = 74;
    var curves = new List<Line>();
    for(int i = 0;f(i, 77) < 51;i++){
      double t = s + g(i);
      curves.Add(new Line(s, f(i, s), 0, t, f(i, t), 0));
    }
    A = curves;
# ---------- c_script: C# additional code ----------
  double f(double a, double b){
    return Math.Tan(Math.PI / 180 * a) * b;
  }
  double g(int i){
    if(i % 10 == 0){
      return 3.0;
    }else if(i % 5 == 0){
      return 2;
    }
    return 1.0;
  }
# ---------- end c_script ----------
